# Grasshopper definition gh.ghx (Grasshopper 0.9.76)
# plug-ins: Python Interpreter

python = PythonScript()  # -> path
# ---------- python: Python ----------
import pickle

import sys
sys.path.append(path)
import GA_func
reload(GA_func)
from GA_func import DNA


path = ghenv.LocalScope.ghdoc.Path
path = path.split("\\")
path = "\\".join(path[:-1]) + "\\"

with open(path + "data.pkl", 'wb') as f:
    pickle.dump("", f)

#with open(path + "process.pkl", 'w') as f:
#    pickle.dump("", f)

pop = 1000

process = {"population": [], "generation": 0, "design": 0, "bestScore": 0, "bestDesign": ""}
    
for i in range(int(pop)):
   process["population"].append(DNA())

with open(path + "process.pkl", 'wb') as f:
    pickle.dump(process, f, pickle.HIGHEST_PROTOCOL)
# ---------- end python ----------
panel = Panel(python)

reset = Button()
step = Button()
run = BooleanToggle(False)

or = GateOr(A=step, B=run)
concat = Concatenate(FragmentA=panel, FragmentB="data.pkl")
concat_2 = Concatenate(FragmentA=panel, FragmentB="script.py")
or_2 = GateOr(A=or, B=reset)
file = ReadFile(File=concat, PerLineParse=False)
file_2 = ReadFile(File=concat_2, PerLineParse=False)
python_2 = PythonScript(Code=file_2, Trigger=file, Path=panel, Pop=Slider(1000, range=0..1000), Flag="run", Active=or, Reset=reset)  # -> Out, Output

# ---- group: print optimization status
python_3 = PythonScript(Code=file_2, Flag="print", Path=panel, Input=python_2.Output)

# ---- group: extract current design
python_4 = PythonScript(Code=file_2, Flag="extract", Path=panel, Input=python_2.Output)  # -> Out, Design

# ----
panel_2 = Panel(python_3)
panel_3 = Panel(python_4.Design)

# ---- group: score current design
python_5 = PythonScript(Code=file_2, Flag="score", Path=panel, Design=python_4.Design, Target="to be or not to be")  # -> Out, Fitness

# ----
panel_4 = Panel(python_5.Fitness)

# ---- group: export current score
python_6 = PythonScript(Code=file_2, Flag="export", Path=panel, Data=python_5.Fitness, Active=or_2)
